# Grasshopper definition 1009.gh (Grasshopper 1.0.7)

ghpython_script = GhPythonScript()  # -> out, a
# ---------- ghpython_script: Python ----------
__author__ = "amomorning"
__version__ = "2020.10.09"

import rhinoscriptsyntax as rs
import calendar


a = []
for i in range(1, 13):
    print(calendar.month(2021, i))
    a.append(calendar.month(2021, i))
# ---------- end ghpython_script ----------
panel = Panel(ghpython_script.a)
panel_2 = Panel(ghpython_script.out)
range = Range(Domain=Domain(0, 11), Steps=11)
graft_tree = GraftTree(Tree=panel, IncludeEmptyLists=True, IncludeNullItems=True)
multiplication = Multiplication(A=range, B=600)
vector_xyz = VectorXYZ(XComponent=multiplication, YComponent="300", ZComponent=0)  # -> graft(Vector), Length
text_tag_3d = TextTag3D(Location=vector_xyz.Vector, Text=graft_tree, Size=Slider(18, range=0..100), Justification=7)
